# Grasshopper definition Johanna trappa 01_grasshopper.gh (Grasshopper 1.0.7)

number_slider = Slider(871.01, range=0..1000)
# WEEK 03
# ASSIGMENT 01 (FAIL)
number_slider_2 = Slider(940, range=0..1000)
# WEEK 03
# ASSIGMENT 01
range = Range(Domain=Domain(0, 1), Steps=number_slider)
range_2 = Range(Domain=number_slider_2, Steps=number_slider)
numbers_to_points = NumbersToPoints(Numbers=range_2, Mask="z")
circle = Circle(Plane=numbers_to_points, Radius=1)

curve = Curve(<curve referenced from the Rhino model>)
explode = Explode(Curve=curve, Recursive=True)  # -> Segments, Vertices
surface = Surface(<surface referenced from the Rhino model>)
unit_z = UnitZ(Factor=Slider(3332.01, range=0..10000))
surface_closest_point = SurfaceClosestPoint(Point=explode.Vertices, Surface=reparameterize(surface))  # -> Point, UVPoint, Distance
curve_2 = Curve(<curve referenced from the Rhino model>)
extrude = Extrude(Base=curve_2, Direction=unit_z)
curve_3 = Curve(<curve referenced from the Rhino model>)
extrude_2 = Extrude(Base=curve_3, Direction=unit_z)
evaluate_surface = EvaluateSurface(Surface=reparameterize(extrude), Point=surface_closest_point.UVPoint)  # -> Point, Normal, UDirection, VDirection, Frame
evaluate_surface_2 = EvaluateSurface(Surface=reparameterize(extrude_2), Point=surface_closest_point.UVPoint)  # -> Point, Normal, UDirection, VDirection, Frame
polyline = PolyLine(Vertices=evaluate_surface_2.Point, Closed=False)
polyline_2 = PolyLine(Vertices=evaluate_surface.Point, Closed=False)
loft = Loft(
    Curves=[polyline, polyline_2],
    Options={Adjust=False, Closed=False, LoftEnds=0, LoftSimp=0, LoftType=0, Rebuild=10, Refit=0.01})

number_slider_3 = Slider(596.716, range=0..5000)
number_slider_4 = Slider(1027.555, range=0..5000)
# WEEK 03
# ASSIGMENT 02
construct_point = ConstructPoint(XCoordinate=0, YCoordinate=0, ZCoordinate=0)
addition = Addition(A=number_slider_3, B=number_slider_4)
construct_point_2 = ConstructPoint(XCoordinate=number_slider_3, YCoordinate=0, ZCoordinate=0)
circle_cnr = CircleCNR(Center=construct_point, Normal=Vector(0, 0, 1), Radius=number_slider_3)
unit_x = UnitX(Factor=1)
circle_cnr_2 = CircleCNR(Center=construct_point, Normal=Vector(0, 0, 1), Radius=addition)
line_sdl = LineSDL(Start=construct_point_2, Direction=unit_x, Length=number_slider_4)
unit_z_2 = UnitZ(Factor=1)
construct_point_3 = ConstructPoint(XCoordinate=0, YCoordinate=0, ZCoordinate=0)
radians = Radians(Degrees=Slider(226.576, range=0..360))
radians_2 = Radians(Degrees=Slider(0, range=0..360))
line_sdl_2 = LineSDL(Start=construct_point_3, Direction=unit_z_2, Length=1)
construct_domain = ConstructDomain(DomainStart=radians, DomainEnd=radians_2)
revolution = Revolution(Curve=line_sdl, Axis=line_sdl_2, Domain=construct_domain)
cull_index = CullIndex(Wrap=True)
scale = Scale(Geometry=cull_index, Center=Point(0, 0, 0), Factor=Slider(870.889, range=0..1000))  # -> Geometry, Transform
ruled_surface = RuledSurface(CurveA=cull_index, CurveB=scale.Geometry)
list_length = ListLength(List=ruled_surface)
series = Series(Start="150", Step="150", Count=list_length)
unit_z_3 = UnitZ(Factor=series)
panel = Panel(series)
move = Move(Geometry=ruled_surface, Motion=unit_z_3)  # -> Geometry, Transform

number_slider_5 = Slider(720, range=0..720)
# WEEK 03
# ASSIGMENT 03
number_slider_6 = Slider(1051, range=0..5000)
construct_domain_2 = ConstructDomain(DomainStart=Slider(0, range=0..1), DomainEnd=number_slider_5)
division = Division(A=number_slider_5, B=Slider(20, range=0..20))
construct_point_4 = ConstructPoint(XCoordinate=number_slider_6, YCoordinate=0, ZCoordinate=0)
range_3 = Range(Domain=construct_domain_2, Steps=division)
xy_plane = XYPlane(Origin=Point(0, 0, 0))
panel_2 = Panel(range_3)
unit_z_4 = UnitZ(Factor=range_3)
rotate = Rotate(Geometry=construct_point_4, Angle=degrees(range_3), Plane=xy_plane)  # -> Geometry, Transform
move_2 = Move(Geometry=rotate.Geometry, Motion=unit_z_4)  # -> Geometry, Transform
interpolate = Interpolate(Vertices=rotate.Geometry, Degree=3, Periodic=False, KnotStyle=1)  # -> Curve, Length, Domain

number_slider_7 = Slider(540, range=0..720)
construct_domain_3 = ConstructDomain(DomainStart=Slider(0, range=0..1), DomainEnd=number_slider_7)
division_2 = Division(A=number_slider_7, B=Slider(19.369, range=0..20))
construct_point_5 = ConstructPoint(XCoordinate=Slider(10000, range=0..20000), YCoordinate=0, ZCoordinate=0)
range_4 = Range(Domain=construct_domain_3, Steps=division_2)
xy_plane_2 = XYPlane(Origin=Point(0, 0, 0))
panel_4 = Panel(range_4)
unit_z_5 = UnitZ(Factor=range_4)
rotate_2 = Rotate(Geometry=construct_point_5, Angle=degrees(range_4), Plane=xy_plane_2)  # -> Geometry, Transform
move_3 = Move(Geometry=rotate_2.Geometry, Motion=unit_z_5)  # -> Geometry, Transform
interpolate_2 = Interpolate(Vertices=rotate_2.Geometry, Degree=3, Periodic=False, KnotStyle=1)  # -> Curve, Length, Domain

# ----
# HANDRAIL FOR THE STAIRCASE test 2
curve_4 = Curve(<curve referenced from the Rhino model>)
fillet = Fillet(Curve=curve_4, Radius=Slider(17.255, range=0..100))
pipe = Pipe(Curve=fillet, Radius=Slider(9.359, range=0..100), Caps=0)
explode_2 = Explode(Curve=fillet, Recursive=False)  # -> Segments, Vertices
list_item = ListItem(List=explode_2.Segments, Index=1, Wrap=True)
deconstruct_arc = DeconstructArc(Arc=list_item)  # -> BasePlane, Radius, Angle
interpolate_3 = Interpolate(Vertices=flatten(deconstruct_arc.BasePlane), Degree=3, Periodic=False, KnotStyle=1)  # -> Curve, Length, Domain
pipe_2 = Pipe(Curve=interpolate_3.Curve, Radius=Slider(51.719, range=0..100), Caps=0)

# ----
# HANDRAIL FOR THE STAIRCASE
curve_5 = Curve(<curve referenced from the Rhino model>)
fillet_2 = Fillet(Curve=curve_5, Radius=Slider(542.51, range=0..1000))
explode_3 = Explode(Curve=fillet_2, Recursive=True)  # -> Segments, Vertices
pipe_3 = Pipe(Curve=fillet_2, Radius=Slider(16.054, range=0..1000), Caps=0)
list_item_2 = ListItem(List=explode_3.Segments, Index=1, Wrap=True)

number_slider_8 = Slider(540, range=0..720)
construct_domain_4 = ConstructDomain(DomainStart=Slider(0, range=0..1), DomainEnd=number_slider_8)
division_3 = Division(A=number_slider_8, B=Slider(10.391, range=0..20))
construct_point_6 = ConstructPoint(XCoordinate=Slider(10000, range=0..20000), YCoordinate=0, ZCoordinate=0)
range_5 = Range(Domain=construct_domain_4, Steps=division_3)
xy_plane_3 = XYPlane(Origin=Point(0, 0, 0))
panel_6 = Panel(range_5)
unit_z_6 = UnitZ(Factor=range_5)
rotate_3 = Rotate(Geometry=construct_point_6, Angle=degrees(range_5), Plane=xy_plane_3)  # -> Geometry, Transform
move_4 = Move(Geometry=rotate_3.Geometry, Motion=unit_z_6)  # -> Geometry, Transform
interpolate_4 = Interpolate(Vertices=rotate_3.Geometry, Degree=3, Periodic=False, KnotStyle=1)  # -> Curve, Length, Domain

move_5 = Move(Motion=Vector(0, 0, 10))  # -> Geometry, Transform

repeat_data = RepeatData(Data="300", Length="10")
merge = Merge(Data1=flatten(repeat_data), Data2=flatten("1000"))
repeat_data_2 = RepeatData(Data=merge, Length=Slider(21.872, range=0..100))
length = Length(Curve=interpolate.Curve)
mass_addition = MassAddition(Input=repeat_data_2)  # -> Result, PartialResults
panel_8 = Panel(repeat_data)
division_4 = Division(A=mass_addition.PartialResults, B=length)
panel_9 = Panel(division_4)

curve_6 = Curve()
deconstruct_arc_2 = DeconstructArc(Arc=list_item_2)  # -> BasePlane, Radius, Angle
rotate_4 = Rotate(Angle=1.570796327, Plane=PlaneXY(0, 0, 0))  # -> Geometry, Transform

repeat_data_3 = RepeatData(Data="300", Length="5")
merge_2 = Merge(Data1=flatten(repeat_data_3), Data2=flatten("3500"))
repeat_data_4 = RepeatData(Data=merge_2, Length=Slider(654.443, range=0..10000))
length_2 = Length(Curve=interpolate_2.Curve)
mass_addition_2 = MassAddition(Input=repeat_data_4)  # -> Result, PartialResults
panel_10 = Panel(repeat_data_3)
division_5 = Division(A=mass_addition_2.PartialResults, B=length_2)
panel_11 = Panel(division_5)

interpolate_5 = Interpolate(Vertices=flatten(deconstruct_arc_2.BasePlane), Degree=1, Periodic=False, KnotStyle=0)  # -> Curve, Length, Domain
pipe_4 = Pipe(Curve=interpolate_5.Curve, Radius=Slider(172.695, range=0..200), Caps=0)

repeat_data_5 = RepeatData(Data="300", Length="5")
merge_3 = Merge(Data1=flatten(repeat_data_5), Data2=flatten("3500"))
repeat_data_6 = RepeatData(Data=merge_3, Length=Slider(917.358, range=0..10000))
length_3 = Length(Curve=interpolate_4.Curve)
mass_addition_3 = MassAddition(Input=repeat_data_6)  # -> Result, PartialResults
panel_12 = Panel(repeat_data_5)
division_6 = Division(A=mass_addition_3.PartialResults, B=length_3)
panel_13 = Panel(division_6)

shatter = Shatter(Curve=reparameterize(interpolate.Curve), Parameters=division_4)
cull_index_2 = CullIndex(List=shatter, Indices=-1, Wrap=True)
scale_2 = Scale(Geometry=cull_index_2, Center=Point(0, 0, 0), Factor=Slider(0.565, range=0..2))  # -> Geometry, Transform
ruled_surface_2 = RuledSurface(CurveA=cull_index_2, CurveB=scale_2.Geometry)
list_length_2 = ListLength(List=ruled_surface_2)
series_2 = Series(Start="150", Step="150", Count=list_length_2)
unit_z_7 = UnitZ(Factor=series_2)
move_6 = Move(Geometry=ruled_surface_2, Motion=unit_z_7)  # -> Geometry, Transform

shatter_2 = Shatter(Curve=reparameterize(interpolate_2.Curve), Parameters=division_5)
shatter_3 = Shatter(Curve=reparameterize(interpolate_4.Curve), Parameters=division_6)
cull_index_3 = CullIndex(List=shatter_2, Indices=-1, Wrap=True)
scale_3 = Scale(Geometry=cull_index_3, Center=Point(0, 0, 0), Factor=Slider(1.2, range=0..2))  # -> Geometry, Transform
cull_index_4 = CullIndex(List=shatter_3, Indices=-1, Wrap=True)
ruled_surface_3 = RuledSurface(CurveA=cull_index_3, CurveB=scale_3.Geometry)
scale_4 = Scale(Geometry=cull_index_4, Center=Point(0, 0, 0), Factor=Slider(1.2, range=0..2))  # -> Geometry, Transform
list_length_3 = ListLength(List=ruled_surface_3)
ruled_surface_4 = RuledSurface(CurveA=cull_index_4, CurveB=scale_4.Geometry)
series_3 = Series(Start="150", Step="150", Count=list_length_3)
list_length_4 = ListLength(List=ruled_surface_4)
unit_z_8 = UnitZ(Factor=series_3)

# ----
# HANDRAIL FOR THE STAIRCASE
move_7 = Move(Geometry=cull_index_3, Motion=unit_z_8)  # -> Geometry, Transform
curve_7 = Curve(move_7.Geometry)
horizontal_frame = HorizontalFrame(Curve=reparameterize(curve_7), Parameter="0.5")
geometry = Geometry([<brep referenced from the Rhino model> x7])
group = Group(Objects=geometry)
panel_14 = Panel("""1
1
1
1
0
1""")
xy_plane_4 = XYPlane(Origin=Point(0, 0, 0))
dispatch = Dispatch(List=horizontal_frame, DispatchPattern=panel_14)  # -> ListA, ListB
orient = Orient(Geometry=group, Source=xy_plane_4, Target=dispatch.ListB)  # -> Geometry, Transform

series_4 = Series(Start="150", Step="150", Count=list_length_4)
interpolate_6 = Interpolate(Degree=3, Periodic=False, KnotStyle=1)  # -> Curve, Length, Domain
move_8 = Move(Geometry=ruled_surface_3, Motion=unit_z_8)  # -> Geometry, Transform
unit_z_9 = UnitZ(Factor=series_4)

# ----
# HANDRAIL BASE 01
move_9 = Move(Geometry=cull_index_4, Motion=unit_z_9)  # -> Geometry, Transform
curve_8 = Curve(move_9.Geometry)
horizontal_frame_2 = HorizontalFrame(Curve=reparameterize(curve_8), Parameter="0.5")
geometry_2 = Geometry([<brep referenced from the Rhino model> x10])
group_2 = Group(Objects=geometry_2)
panel_15 = Panel("""0
0
0
0
0
1""")
xy_plane_5 = XYPlane(Origin=Point(0, 0, 0))
dispatch_2 = Dispatch(List=horizontal_frame_2, DispatchPattern=panel_15)  # -> ListA, ListB
orient_2 = Orient(Geometry=group_2, Source=xy_plane_5, Target=dispatch_2.ListB)  # -> Geometry, Transform

# ----
# HANDRAIL FOR THE STAIRCASE
move_10 = Move(Geometry=cull_index_4, Motion=unit_z_9)  # -> Geometry, Transform
curve_9 = Curve(move_10.Geometry)
horizontal_frame_3 = HorizontalFrame(Curve=reparameterize(curve_9), Parameter="-1")
geometry_3 = Geometry([<brep referenced from the Rhino model>, <point referenced from the Rhino model>, <brep referenced from the Rhino model> x65, <curve referenced from the Rhino model>, <brep referenced from the Rhino model> x16])
group_3 = Group(Objects=geometry_3)
panel_16 = Panel("""1
1
1
1
0
1""")
xy_plane_6 = XYPlane(Origin=Point(0, 0, 0))
dispatch_3 = Dispatch(List=horizontal_frame_3, DispatchPattern=panel_16)  # -> ListA, ListB
orient_3 = Orient(Geometry=group_3, Source=xy_plane_6, Target=dispatch_3.ListB)  # -> Geometry, Transform

move_11 = Move(Geometry=cull_index_4, Motion=unit_z_9)  # -> Geometry, Transform
number_slider_9 = Slider(0.653, range=0..1)

# ----
# GEOMETRY THAT INTEGRATE WITH THE STEPS
move_12 = Move(Geometry=cull_index_3, Motion=unit_z_8)  # -> Geometry, Transform
curve_10 = Curve(move_12.Geometry)
horizontal_frame_4 = HorizontalFrame(Curve=reparameterize(curve_10), Parameter="0.5")
geometry_4 = Geometry(<brep referenced from the Rhino model>)
group_4 = Group(Objects=geometry_4)
panel_17 = Panel("""0
0
0
0
1
0""")
xy_plane_7 = XYPlane(Origin=Point(0, 0, 0))
dispatch_4 = Dispatch(List=horizontal_frame_4, DispatchPattern=panel_17)  # -> ListA, ListB
orient_4 = Orient(Geometry=group_4, Source=xy_plane_7, Target=dispatch_4.ListB)  # -> Geometry, Transform

# ----
# VOLUME, STAIRCASE
number_slider_10 = Slider(76.694, range=0..200)
surface_2 = Surface(move_8.Geometry)
unit_z_10 = UnitZ(Factor=number_slider_10)
extrude_3 = Extrude(Base=surface_2, Direction=unit_z_10)

move_13 = Move(Geometry=ruled_surface_4, Motion=unit_z_9)  # -> Geometry, Transform

# ----
# GEOMETRY THAT INTEGRATE WITH THE STEPS
move_14 = Move(Geometry=cull_index_4, Motion=unit_z_9)  # -> Geometry, Transform
curve_11 = Curve(move_14.Geometry)
horizontal_frame_5 = HorizontalFrame(Curve=reparameterize(curve_11), Parameter="1")
geometry_5 = Geometry([<brep referenced from the Rhino model> x3])
group_5 = Group(Objects=geometry_5)
panel_18 = Panel("""-1
1
1
1
1
1
1""")
xy_plane_8 = XYPlane(Origin=Point(0, 0, 0))
dispatch_5 = Dispatch(List=horizontal_frame_5, DispatchPattern=panel_18)  # -> ListA, ListB
orient_5 = Orient(Geometry=group_5, Source=xy_plane_8, Target=dispatch_5.ListB)  # -> Geometry, Transform

# ----
# VOLUME, STAIRCASE
number_slider_11 = Slider(32.478, range=0..200)
surface_3 = Surface(move_13.Geometry)
unit_z_11 = UnitZ(Factor=number_slider_11)
extrude_4 = Extrude(Base=surface_3, Direction=unit_z_11)

pipe_5 = Pipe(Curve=move_11.Geometry, Radius="10", Caps=0)
divide_curve = DivideCurve(Curve=move_11.Geometry, Count=Slider(0.59, range=0..1), Kinks=False)  # -> Points, Tangents, Parameters
point = Point(<point referenced from the Rhino model>)
point_2 = Point(<point referenced from the Rhino model>)
cull_pattern = CullPattern(List=divide_curve.Points, CullPattern=[False, False, True, True])
orient_6 = Orient(Geometry=point, Source=xy_plane_5, Target=dispatch_2.ListB)  # -> Geometry, Transform
orient_7 = Orient(Geometry=point_2, Source=xy_plane_5, Target=dispatch_2.ListB)  # -> Geometry, Transform
polyline_3 = PolyLine(Vertices=orient_6.Geometry, Closed=False)
polyline_4 = PolyLine(Vertices=orient_7.Geometry, Closed=False)
explode_4 = Explode(Curve=polyline_3, Recursive=True)  # -> Segments, Vertices
explode_5 = Explode(Curve=polyline_4, Recursive=True)  # -> Segments, Vertices
length_4 = Length(Curve=explode_4.Segments)
length_5 = Length(Curve=explode_5.Segments)
average = Average(Input=length_4)
average_2 = Average(Input=length_5)
smaller_than = SmallerThan(FirstNumber=length_4, SecondNumber=average)  # -> SmallerThan, OrEqualTo
smaller_than_2 = SmallerThan(FirstNumber=length_5, SecondNumber=average_2)  # -> SmallerThan, OrEqualTo
dispatch_6 = Dispatch(List=explode_4.Segments, DispatchPattern=smaller_than.SmallerThan)  # -> ListA, ListB
dispatch_7 = Dispatch(List=explode_5.Segments, DispatchPattern=smaller_than_2.SmallerThan)  # -> ListA, ListB
length_6 = Length(Curve=dispatch_6.ListA)
length_7 = Length(Curve=dispatch_7.ListA)
average_3 = Average(Input=length_6)
join_curves = JoinCurves(Curves=dispatch_6.ListA, Preserve=False)
curve_12 = Curve(dispatch_6.ListB)
horizontal_frame_6 = HorizontalFrame(Curve=reparameterize(curve_12), Parameter=0.5)  # -> simplify(Frame)
average_4 = Average(Input=length_7)
join_curves_2 = JoinCurves(Curves=dispatch_7.ListA, Preserve=False)
curve_13 = Curve(dispatch_7.ListB)
horizontal_frame_7 = HorizontalFrame(Curve=reparameterize(curve_13), Parameter=0.5)  # -> simplify(Frame)
extend_curve = ExtendCurve(Curve=join_curves, Type=0, Start=expr("x*2", average_3), End=expr("x*2", average_3))  # -> simplify(Curve)
extend_curve_2 = ExtendCurve(Curve=join_curves_2, Type=0, Start=expr("x*2", average_4), End=expr("x*2", average_4))  # -> simplify(Curve)
graft_tree = GraftTree(Tree=extend_curve, IncludeEmptyLists=True, IncludeNullItems=True)
graft_tree_2 = GraftTree(Tree=horizontal_frame_6, IncludeEmptyLists=True, IncludeNullItems=True)
graft_tree_3 = GraftTree(Tree=extend_curve_2, IncludeEmptyLists=True, IncludeNullItems=True)
graft_tree_4 = GraftTree(Tree=horizontal_frame_7, IncludeEmptyLists=True, IncludeNullItems=True)
curve_plane = CurvePlane(Curve=reparameterize(graft_tree), Plane=horizontal_frame_6)  # -> simplify(Points), ParamsC, ParamsP
curve_plane_2 = CurvePlane(Curve=extend_curve, Plane=graft_tree_2)  # -> simplify(Points), ParamsC, ParamsP
curve_plane_3 = CurvePlane(Curve=reparameterize(graft_tree_3), Plane=horizontal_frame_7)  # -> simplify(Points), ParamsC, ParamsP
curve_plane_4 = CurvePlane(Curve=extend_curve_2, Plane=graft_tree_4)  # -> simplify(Points), ParamsC, ParamsP
shift_paths = ShiftPaths(Data=simplify(curve_plane_2.Points), Offset=-1)
shift_paths_2 = ShiftPaths(Data=simplify(curve_plane.ParamsC), Offset=-1)
shift_paths_3 = ShiftPaths(Data=simplify(curve_plane_4.Points), Offset=-1)
shift_paths_4 = ShiftPaths(Data=simplify(curve_plane_3.ParamsC), Offset=-1)
polyline_5 = PolyLine(Vertices=shift_paths, Closed=False)
polyline_6 = PolyLine(Vertices=shift_paths_3, Closed=False)
shatter_4 = Shatter(Curve=reparameterize(graft_tree), Parameters=shift_paths_2)
shatter_5 = Shatter(Curve=reparameterize(graft_tree_3), Parameters=shift_paths_4)
length_8 = Length(Curve=shatter_4)
length_9 = Length(Curve=shatter_5)
average_5 = Average(Input=length_8)
average_6 = Average(Input=length_9)
smaller_than_3 = SmallerThan(FirstNumber=length_8, SecondNumber=average_5)  # -> SmallerThan, OrEqualTo
smaller_than_4 = SmallerThan(FirstNumber=length_9, SecondNumber=average_6)  # -> SmallerThan, OrEqualTo
dispatch_8 = Dispatch(List=shatter_4, DispatchPattern=smaller_than_3.SmallerThan)  # -> ListA, ListB
dispatch_9 = Dispatch(List=shatter_5, DispatchPattern=smaller_than_4.SmallerThan)  # -> ListA, ListB
curve_14 = Curve(dispatch_8.ListB)
curve_15 = Curve(dispatch_9.ListB)
join_curves_3 = JoinCurves(Curves=flatten([polyline_5, curve_14]), Preserve=False)
join_curves_4 = JoinCurves(Curves=flatten([polyline_6, curve_15]), Preserve=False)
pipe_6 = Pipe(Curve=join_curves_3, Radius=20, Caps=0)
pipe_7 = Pipe(Curve=join_curves_4, Radius=20, Caps=0)
geometry_6 = Geometry([pipe_6, orient_3.Geometry])
panel_19 = Panel(join_curves_3)
panel_20 = Panel(join_curves_4)
